# Grasshopper definition HVACSystemWorkflow.gh (Grasshopper 1.0.7)
# plug-ins: Ironbug.Grasshopper

brep = Brep()

# ----
# FourPipeFanCoil
coilhw = Ironbug_CoilHeatingWater()  # -> AirSide_CoilHeatingWater, WaterSide_CoilHeatingWater
coilclnwater = Ironbug_CoilCoolingWater()  # -> AirSide_CoilCoolingWater, WaterSide_CoilCoolingWater
lng = ListLength(List=brep)
panel = Panel(lng)
duplicate = Ironbug_Duplicate(Reference=coilclnwater.AirSide_CoilCoolingWater, Amount=panel)  # -> flatten(Objects), flatten(WaterSide_CoilCoolingWater)
duplicate_2 = Ironbug_Duplicate(Reference=coilhw.AirSide_CoilHeatingWater, Amount=panel)  # -> flatten(Objects), flatten(WaterSide_CoilHeatingWater)
_4pipefancoil = Ironbug_ZoneHVACFourPipeFanCoil(HeatingCoil=duplicate_2.Objects, CoolingCoil=duplicate.Objects)

brep_2 = Brep([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])
honeybee = Honeybee_Honeybee()  # -> Vviiiiiiiiiizzz; plug-in component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
ladybug = Ladybug_Ladybug()  # -> Vviiiiiiiiiizzz; plug-in component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
intersectmass = IntersectMass(x=brep_2)  # -> out, A; inputs x: list of Brep
# ---------- intersectmass: C# ----------
    var tolerance = Rhino.RhinoDoc.ActiveDoc.ModelAbsoluteTolerance;
    List<Brep> allOldBreps = x;

    if (x.Count() > 0)
    {
      var results = allOldBreps.AsParallel().AsOrdered().Select(b => SplitBrepWithBreps(b, allOldBreps, tolerance));
      A = results;
    }

    //SplitBrepWithBreps(x[0], x, tolerance);
# ---------- intersectmass: C# additional code ----------
  static Brep SplitBrepWithBreps(Brep CurrentBrep, List<Brep> AllBreps, double tolerance)
  {
    var currentBrep = CurrentBrep;
    var allBreps = AllBreps;

    foreach (Brep item in allBreps)
    {
      var  tempBrep = currentBrep.Split(item, tolerance);
      if (tempBrep.Count() > 0)
      {
        var newBrep = Rhino.Geometry.Brep.JoinBreps(tempBrep, tolerance);

        currentBrep = newBrep.First();
        currentBrep.Faces.ShrinkFaces();
      }
    }
    return currentBrep;

  }
# ---------- end intersectmass ----------
number_slider = Slider(0.7, range=0..1)
mass2zone = Honeybee_Masses2Zones(zoneMasses=flatten(intersectmass.A), maxRoofAngle=30, createHBZones=Toggle(True))  # -> readMe, HBZones; plug-in component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
# HBZones
brep_3 = Brep()
panel_2 = Panel("https://www.energyplus.net/weather-download/north_and_central_america_wmo_region_4/USA/NY/USA_NY_New.York-LaGuardia.AP.725030_TMY3/all")

# ----
# Airloop
panel_3 = Panel("DifferentialDryBulb")
objparams = Ironbug_ObjParams(EconomizerControlType=panel_3, DataFieldSetType="Ironbug.HVAC.IB_ControllerOutdoorAir_DataFieldSet")
objparams_2 = Ironbug_ObjParams(PressureRise="500", DataFieldSetType="Ironbug.HVAC.IB_FanConstantVolume_DataFields")
oacontroller = Ironbug_OAController(Parameters=objparams)
thermalzone = Ironbug_ThermalZone(HoneybeeZone=brep_3)
objparams_3 = Ironbug_ObjParams(
    AllOutdoorAirinCooling=Toggle(True),
    AllOutdoorAirinHeating=Toggle(True),
    CentralHeatingDesignSupplyAirTemperature="40",
    MinimumSystemAirFlowRatio="1",
    DataFieldSetType="Ironbug.HVAC.IB_SizingSystem_FieldSet")
item = ListItem(List=thermalzone, Index=0, Wrap=True)
oasystem = Ironbug_OutdoorAirSystem(Controller_=oacontroller)
spm_szreheat = Ironbug_SetpointManagerSingleZoneReheat(ControlZone=flatten(item), MinTemperature=10, MaxTemperature=50)
coilhtnelec = Ironbug_CoilHeatingElectric()
fanconstant = Ironbug_FanConstantVolume(Parameters_=objparams_2)
szsystem = Ironbug_SizingSystem(Parameters=objparams_3)
branches = AirLoopBranches(Branch1=thermalzone)
merge = Merge(Data1=oasystem, Data2=coilhtnelec, Data3=fanconstant, Data4=spm_szreheat)
airloop = Ironbug_AirLoopHVAC(Supply=merge, Demand=branches, SizingSystem=szsystem)

glzparamlist = Honeybee_GlazingParametersList(northGlzParam=0, westGlzParam=0, southGlzParam=number_slider, eastGlzParam=number_slider)  # -> glzParamList; plug-in component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
solveadjc = Honeybee_SolveAdjacencies(HBZones=flatten(mass2zone.HBZones), removeCurrentAdjc=False, findAdjc=Toggle(True))  # -> readMe, HBZonesWADJ; plug-in component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
glazingcreator = Honeybee_GlazingBasedOnRatio(HBObjects=solveadjc.HBZonesWADJ, glzRatio=glzparamlist, runIt=Toggle(True))  # -> readMe, HBObjWGLZ; plug-in component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
data = Data(flatten(glazingcreator.HBObjWGLZ))
epw_stat = Ladybug_OpenEPWAndSTATWeatherFiles(weatherFileURL=panel_2)  # -> epwFile, statFile; plug-in component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
graft = GraftTree(Tree=brep, IncludeEmptyLists=True, IncludeNullItems=True)
graft_2 = GraftTree(Tree=_4pipefancoil, IncludeEmptyLists=True, IncludeNullItems=True)

# ----
# Airloop
panel_4 = Panel("DifferentialDryBulb")
objparams_4 = Ironbug_ObjParams(EconomizerControlType=panel_4, DataFieldSetType="Ironbug.HVAC.IB_ControllerOutdoorAir_DataFieldSet")
objparams_5 = Ironbug_ObjParams(PressureRise="500", DataFieldSetType="Ironbug.HVAC.IB_FanConstantVolume_DataFields")
oacontroller_2 = Ironbug_OAController(Parameters=objparams_4)
heatexchanger_air = Ironbug_HeatExchangerAirToAirSensibleAndLatent()
objparams_6 = Ironbug_ObjParams(
    AllOutdoorAirinCooling=Toggle(True),
    AllOutdoorAirinHeating=Toggle(True),
    CentralHeatingDesignSupplyAirTemperature="40",
    MinimumSystemAirFlowRatio="1",
    DataFieldSetType="Ironbug.HVAC.IB_SizingSystem_FieldSet")
oasystem_2 = Ironbug_OutdoorAirSystem(HeatRecovery_=heatexchanger_air, Controller_=oacontroller_2)
coilcw = Ironbug_CoilCoolingWater()  # -> AirSide_CoilCoolingWater, WaterSide_CoilCoolingWater
coilhw_2 = Ironbug_CoilHeatingWater()  # -> AirSide_CoilHeatingWater, WaterSide_CoilHeatingWater
thermalzone_2 = Ironbug_ThermalZone(HoneybeeZone=graft, ZoneEquipments=graft_2)
spscheduled = Ironbug_SetpointManagerScheduled(Temperature="20")
fanconstant_2 = Ironbug_FanConstantVolume(Parameters_=objparams_5)
szsystem_2 = Ironbug_SizingSystem(Parameters=objparams_6)
branches_2 = AirLoopBranches(Branch1=flatten(thermalzone_2))
merge_2 = Merge(
    Data1=oasystem_2,
    Data2=coilcw.AirSide_CoilCoolingWater,
    Data3=coilhw_2.AirSide_CoilHeatingWater,
    Data4=fanconstant_2,
    Data5=spscheduled)
airloop_2 = Ironbug_AirLoopHVAC(Supply=merge_2, Demand=branches_2, SizingSystem=szsystem_2)

graft_3 = GraftTree(Tree=duplicate_2.WaterSide_CoilHeatingWater, IncludeEmptyLists=True, IncludeNullItems=True)
graft_4 = GraftTree(Tree=duplicate.WaterSide_CoilCoolingWater, IncludeEmptyLists=True, IncludeNullItems=True)
hvacsystemslist = Honeybee_HVACSystemsList({"-1. Thermostat Only": -1, "0. Ideal Air Loads": 0, "1. PTAC | Residential": 1, "2. PTHP | Residential": 2, "3. Packaged Single Zone - AC": 3, "4. Packaged Single Zone - HP": 4, "5. Packaged VAV w/ Reheat": 5, "6. Packaged VAV w/ PFP Boxes": 6, "7. VAV w/ Reheat": 7, "8. VAV w/ PFP Boxes": 8, "9. Warm Air Furnace - Gas Fired": 9, "10.Warm Air Furnace - Electric": 10, "11.Fan Coil Units + DOAS": 11, "12.Active Chilled Beams + DOAS": 12, "13.Radiant Floors + DOAS": 13, "14.Custom Rad Surfaces + DOAS": 14, "15.Heated Surfaces + VAV Cooling": 15, "16.VRF + DOAS": 16, "17.WSHP + DOAS": 17}, selected="11.Fan Coil Units + DOAS")
coolingtowerv = Ironbug_CoolingTowerVariableSpeed()

# ----
# Hot water loop
boilerhw = Ironbug_BoilerHotWater()
spscheduled_2 = Ironbug_SetpointManagerScheduled(Temperature="67")
pumpvariable = Ironbug_PumpVariableSpeed()
branches_3 = PlantBranches(Branch1=boilerhw)
branches_4 = PlantBranches(Branch1=graft_3, Branch=coilhw_2.WaterSide_CoilHeatingWater)
hwloop = Ironbug_HotWaterPlantLoop(Supply=[pumpvariable, branches_3, spscheduled_2], Demand=branches_4)

# ----
# Chilled water loop
chillere = Ironbug_ChillerElectricEIR()  # -> ChillerElectricEIR, ChillerElectricEIR_CondenserLoop
spscheduled_3 = Ironbug_SetpointManagerScheduled(Temperature="6.7")
pumpvariable_2 = Ironbug_PumpVariableSpeed()
branches_5 = PlantBranches(Branch1=chillere.ChillerElectricEIR)
branches_6 = PlantBranches(Branch1=coilcw.WaterSide_CoilCoolingWater, Branch=graft_4)
cwloop = Ironbug_ChilledWaterPlantLoop(Supply=[pumpvariable_2, branches_5, spscheduled_3], Demand=branches_6)

# ----
# Condenser water loop
pipeadiabatic = Ironbug_PipeAdiabatic()
spfollowoatemp = Ironbug_SetpointManagerFollowOutdoorAirTemperature(MaximumSetpointTemperature="80", MinimumSetpointTemperature="5", OffsetTemperatureDifference="0")
pumpvariable_3 = Ironbug_PumpVariableSpeed()
branches_7 = PlantBranches(Branch1=coolingtowerv, Branch=pipeadiabatic)
branches_8 = PlantBranches(Branch1=chillere.ChillerElectricEIR_CondenserLoop)
dwloop = Ironbug_CondenserWaterPlantLoop(Supply=[pumpvariable_3, branches_7, spfollowoatemp], Demand=branches_8)

hvacsystem = Ironbug_HVACSystem(AirLoops=flatten(airloop))
hvacsystem_2 = Honeybee_AssignHVACSystem(HBZones=glazingcreator.HBObjWGLZ, HVACSystems=hvacsystemslist)  # -> readMe, HBZones; plug-in component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
merge_3 = Merge(Data1=hwloop, Data2=cwloop, Data3=dwloop)
toggle = BooleanToggle(False)
toggle_2 = BooleanToggle(False)
hvacsystem_3 = Ironbug_HVACSystem(AirLoops=flatten(airloop_2), PlantLoops=flatten(merge_3))
exporttoopenstudio = Honeybee_ExportToOpenStudio(
    epwWeatherFile=epw_stat.epwFile,
    HBZones=flatten(glazingcreator.HBObjWGLZ),
    HVACSystem=flatten(hvacsystem_3),
    writeOSM=toggle,
    openOpenStudio=toggle,
    fileName="IB_Sys")  # -> readMe, osmFileAddress, idfFileAddress, resultFileAddress, eioFileAddress, rddFileAddress, htmlReport, studyFolder, model; plug-in component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
exporttoopenstudio_2 = Honeybee_ExportToOpenStudio(
    epwWeatherFile=epw_stat.epwFile,
    HBZones=flatten(hvacsystem_2.HBZones),
    writeOSM=toggle_2,
    openOpenStudio=toggle_2,
    fileName="HB_Sys")  # -> readMe, osmFileAddress, idfFileAddress, resultFileAddress, eioFileAddress, rddFileAddress, htmlReport, studyFolder, model; plug-in component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
readepresult = Honeybee_ReadEPResult(resultFileAddress=exporttoopenstudio_2.resultFileAddress)  # -> totalThermalLoad, thermalLoadBalance, cooling, heating, electricLight, electricEquip, fanElectric, pumpElectric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; plug-in component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
c_script = CSharpScript(x=exporttoopenstudio.osmFileAddress, Reference="C:\openstudio-2.5.0\CSharp\openstudio\OpenStudio.dll")  # -> out, A; inputs x: String; disabled
# ---------- c_script: C# ----------
    if (!string.IsNullOrEmpty(x))
    {
      var p = new OpenStudio.Path(x);
      var m = OpenStudio.Model.load(p).get();
      var plantLps = m.getPlantLoops();
      foreach (OpenStudio.PlantLoop pl in plantLps)
      {
        
        var tp = pl.sizingPlant().loopType();
        Print(pl.nameString() + "_" + tp);
      }
    }
# ---------- end c_script ----------
readepresult_2 = Honeybee_ReadEPResult(resultFileAddress=exporttoopenstudio.resultFileAddress)  # -> totalThermalLoad, thermalLoadBalance, cooling, heating, electricLight, electricEquip, fanElectric, pumpElectric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; plug-in component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
panel_5 = Panel(exporttoopenstudio.osmFileAddress)
strnum = Ladybug_SeparateData(inputList=flatten(readepresult.cooling))  # -> numbers, strings; plug-in component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
strnum_2 = Ladybug_SeparateData(inputList=flatten(readepresult.heating))  # -> numbers, strings; plug-in component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
strnum_3 = Ladybug_SeparateData(inputList=flatten(readepresult_2.cooling))  # -> numbers, strings; plug-in component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
strnum_4 = Ladybug_SeparateData(inputList=flatten(readepresult_2.heating))  # -> numbers, strings; plug-in component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
ma = MassAddition(Input=flatten(strnum.numbers))  # -> Result, PartialResults
ma_2 = MassAddition(Input=strnum_2.numbers)  # -> Result, PartialResults
ma_3 = MassAddition(Input=strnum_3.numbers)  # -> Result, PartialResults
ma_4 = MassAddition(Input=strnum_4.numbers)  # -> Result, PartialResults
panel_6 = Panel(ma_2.Result)
panel_7 = Panel(ma.Result)
panel_8 = Panel(ma_4.Result)
panel_9 = Panel(ma_3.Result)
timer = Timer(TimerInterval=1000)
list = ValueList({"One": 1, "Two": 2, "Three": 2² - 1, "Four": Sqrt(16)}, selected="One")
knob = ControlKnob(Decimals=2, Limit=True, Maximum=10, Minimum=0, Range=1, Value=1.03)
digit_scroller = DigitScroller(Scroller_Digits=12, Scroller_Radix=9, Scroller_Value=0.25)
item_2 = CherryPicker(ListIndex=0)
gradient = Gradient(LowerLimit=0, UpperLimit=1, stops=[0.15: RGB(255, 130, 160), 0.85: RGB(220, 0, 40)])
dam = DataDam(BufferDelay=10000000, BufferMode=0)
nblur = BlurNumbers(Strength=0.5, Iterations=1, Lock=True, Wrap=False)
hvactemplate = Ironbug_HVACTemplate(_run=Button())
list_2 = ValueList({"One": 1, "Two": 2, "Three": 2² - 1, "Four": Sqrt(16)}, selected="One")
